# Grasshopper definition WIKIHOUSE_TFGII_UFN_R02.gh (Grasshopper 0.9.76)
# Copyright: Copyleft!
# plug-ins: ShapeDiver

# ----
# VALUE STEP INFO
num = Number(2400)
num_2 = Number(3600)
num_3 = Number(-1650)
num_4 = Number(1650)
num_5 = Number(50)
num_6 = Number(400)
dom = ConstructDomain(DomainStart=num, DomainEnd=num_2)
dom_2 = ConstructDomain(DomainStart=num_3, DomainEnd=num_4)
dom_3 = ConstructDomain(DomainStart=num_5, DomainEnd=num_6)
range = Range(Domain=dom, Steps="40")
range_2 = Range(Domain=dom_2, Steps="55")
range_3 = Range(Domain=dom_3, Steps="35")
panel = Panel(range)
panel_2 = Panel(range_2)
panel_3 = Panel(range_3)

# ----
# DEFINIÇÃO DOS VÉRTICES
vão_transversal = ValueList({"1500 cm": 1650, "2000 cm": 2300, "2500 cm": 2650, "3000 cm": 3300, "3500 cm": 3650}, selected="3500 cm")
division = Division(A=vão_transversal, B="2")

# ----
# V6
posição_cobertura_p2 = ValueList({"-1650.0", "-1590.0", "-1530.0", "-1470.0", "-1410.0", "-1350.0", "-1290.0", "-1230.0", "-1170.0", "-1110.0"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}, selected="-390.0")
altura_cobertura_p2 = ValueList({"2400.0", "2430.0", "2460.0", "2490.0", "2520.0", "2550.0", "2580.0", "2610.0", "2640.0", "2670.0"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}, selected="2520.0")
multiplication = Multiplication(A=altura_cobertura_p2, B="1")
usar_p2_0_não_1_sim = Slider(0, range=0..1)
pt = ConstructPoint(XCoordinate=posição_cobertura_p2, YCoordinate="0", ZCoordinate=multiplication)
expression = Expression(x=usar_p2_0_não_1_sim, y=pt, z="0", Expression="If(x=1,y,z)")
pt_2 = Point(expression)

# ----
# V7
posição_cobertura_p3 = ValueList({"-1650.0", "-1590.0", "-1530.0", "-1470.0", "-1410.0", "-1350.0", "-1290.0", "-1230.0", "-1170.0", "-1110.0"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}, selected="-390.0")
altura_cobertura_p3 = ValueList({"2400.0", "2430.0", "2460.0", "2490.0", "2520.0", "2550.0", "2580.0", "2610.0", "2640.0", "2670.0"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}, selected="2580.0")
multiplication_2 = Multiplication(A=altura_cobertura_p3, B="1")
usar_p3_0_não_1_sim = Slider(0, range=0..1)
pt_3 = ConstructPoint(XCoordinate=posição_cobertura_p3, YCoordinate="0", ZCoordinate=multiplication_2)
expression_2 = Expression(x=usar_p3_0_não_1_sim, y=pt_3, z="0", Expression="If(x=1,y,z)")
pt_4 = Point(expression_2)

# ----
# V2
panel_4 = Panel("1")
multiplication_3 = Multiplication(A=division, B=panel_4)
pt_5 = ConstructPoint(XCoordinate=multiplication_3, YCoordinate="0", ZCoordinate="0")

# ----
# V4
altura_lado_direito = ValueList({"2400 cm": 2400, "2460 cm": 2460, "2520 cm": 2520, "2580 cm": 2580, "2640 cm": 2640, "2700 cm": 2700, "2760 cm": 2760, "2820 cm": 2820, "2880 cm": 2880, "2940 cm": 2940, "3000 cm": 3000}, selected="2400 cm")
multiplication_4 = Multiplication(A=altura_lado_direito, B="1")
pt_6 = ConstructPoint(XCoordinate=multiplication_3, YCoordinate="0", ZCoordinate=multiplication_4)

# ----
# V5
altura_cobertura_p1 = ValueList({"2400.0", "2430.0", "2460.0", "2490.0", "2520.0", "2550.0", "2580.0", "2610.0", "2640.0", "2670.0"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}, selected="3600.0")
posição_cobertura_p1 = ValueList({"-1650.0", "-1590.0", "-1530.0", "-1470.0", "-1410.0", "-1350.0", "-1290.0", "-1230.0", "-1170.0", "-1110.0"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}, selected="-390.0")
multiplication_5 = Multiplication(A=altura_cobertura_p1, B="1")
pt_7 = ConstructPoint(XCoordinate=posição_cobertura_p1, YCoordinate="0", ZCoordinate=multiplication_5)

# ----
# V1
panel_5 = Panel("-1")
multiplication_6 = Multiplication(A=division, B=panel_5)
pt_8 = ConstructPoint(XCoordinate=multiplication_6, YCoordinate="0", ZCoordinate="0")

# ----
# V3
altura_lado_esquerdo = ValueList({"2400 cm": 2400, "2460 cm": 2460, "2520 cm": 2520, "2580 cm": 2580, "2640 cm": 2640, "2700 cm": 2700, "2760 cm": 2760, "2820 cm": 2820, "2880 cm": 2880, "2940 cm": 2940, "3000 cm": 3000}, selected="2400 cm")
multiplication_7 = Multiplication(A=altura_lado_esquerdo, B="1")
pt_9 = ConstructPoint(XCoordinate=multiplication_6, YCoordinate="0", ZCoordinate=multiplication_7)

# ----
# VÉRTICES -> PERFIL
nurbs = NurbsCurve(Vertices=[pt_9, pt_8, pt_5, pt_6, pt_7, pt_2, pt_4], Degree=1, Periodic=True)  # -> Curve, Length, Domain

# ----
# DEFINIÇÃO DO PERFIL
# 1- escolher a curva;
# 2- definir largura;
largura_do_perfil = ValueList({"100 mm": "100.0", "110 mm": "110.0", "120 mm": "120.0", "130 mm": "130.0", "140 mm": "140.0", "150 mm": "150.0", "160 mm": "160.0", "170 mm": "170.0", "180 mm": "180.0", "190 mm": "190.0"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}, selected="300 mm": "300.0")
division_2 = Division(A=largura_do_perfil, B="2")
multiplication_8 = Multiplication(A=division_2, B="-1")
crv = Curve(nurbs.Curve)

vão_longitudinal = ValueList({"50 cm": 500, "70 cm": 700, "100 cm": 1000, "120 cm": 1200, "150 cm": 1500}, selected="150 cm")

# ----
# OFFSET P/ DEFINIR LARG.
# CURVA -> SUPERFÍCIE
offset = Offset(Curve=crv, Distance=division_2, Plane=PlaneXY(0, 0, 0), Corners=1)
offset_2 = Offset(Curve=crv, Distance=multiplication_8, Plane=PlaneXY(0, 0, 0), Corners=1)
offset_perfil_externo = Curve(offset)
offset_perfil_interno = Curve(offset_2)
join = JoinCurves(Curves=flatten([offset_perfil_interno, offset_perfil_externo]), Preserve=False)
boundary = BoundarySurfaces(Edges=flatten(join))

# ----
# MÓDULOS E VÃO ENTRE MÓDULOS
# 1 - Definir Nº de Módulos
# 2 - Definir vão entre módulos
nº_de_módulos = Slider(3, range=1..25)
multiplication_9 = Multiplication(A=vão_longitudinal, B="2")
multiplication_10 = Multiplication(A=multiplication_9, B=nº_de_módulos)
division_3 = Division(A=multiplication_9, B="2")
Y = UnitY(Factor=multiplication_9)
Y_2 = UnitY(Factor=division_3)
panel_6 = Panel(nº_de_módulos)

division_4 = Division(A=multiplication_10, B="2")

comp_total = Panel(division_4)

# ----
# CÓPIAS DO PERFIL
# DEFINIÇÃO DA
# ESPESSURA DA
# PEÇA
espessura_da_peça = ValueList({"10 mm": 10, "12 mm": 12, "14 mm": 14, "16 mm": 16, "18 mm": 18, "20 mm": 20, "24 mm": 24, "30 mm": 30, "36 mm": 36}, selected="36 mm")
move = Move(Geometry=boundary, Motion=Y)  # -> Geometry, Transform
arrlinear = LinearArray(Geometry=[move.Geometry, boundary], Direction=Y_2, Count=panel_6)  # -> flatten(Geometry), Transform
Y_3 = UnitY(Factor=espessura_da_peça)
extr = Extrude(Base=arrlinear.Geometry, Direction=Y_3)

jagged = SettingsSpeed()
mesh = MeshBrep(Brep=extr, Settings=jagged)

# ----
# SHAPEDIVER
brep = Brep(extr)
formato_do_arquivo = Panel("3dm")
nome_do_arquivo = Panel("WikiHouse_TFGII_UFN_R01")
download_do_modelo = ShapeDiverExportDownload(Geometry=brep, Format=formato_do_arquivo, Name=nome_do_arquivo)

materialidade = ValueList({"Padrão": 100, "Plástico": 200, "Metal": 300, "Madeira": 500}, selected="Madeira")
panel_7 = Panel(materialidade)
sdsimplematerial = ShapeDiverSimpleMaterial(Color=RGB(255, 255, 255), MaterialIndex=panel_7)
displaybox = ShapeDiverDisplayGeometry(Geometry=mesh, ShapeDiverMaterial=sdsimplematerial)
