# Grasshopper definition WIKIHOUSE_TFGII_UFN_R05.gh (Grasshopper 0.9.76)
# Copyright: Copyleft!
# plug-ins: ShapeDiver

# ----
# DEFINIÇÃO DOS VÉRTICES
vão_transversal_p02 = ValueList({"1500 cm": 1800, "2000 cm": 2300, "2500 cm": 2800, "3000 cm": 3300, "3500 cm": 3800}, selected="3000 cm")
division = Division(A=vão_transversal_p02, B="2")

# ----
# DEFINIÇÃO DOS VÉRTICES
vão_transversal_p03 = ValueList({"1500 cm": 1800, "2000 cm": 2300, "2500 cm": 2800, "3000 cm": 3300, "3500 cm": 3800}, selected="3000 cm")
division_2 = Division(A=vão_transversal_p03, B="2")

# ----
# DEFINIÇÃO DOS VÉRTICES
vão_transversal_p01 = ValueList({"1500 cm": 1800, "2000 cm": 2300, "2500 cm": 2800, "3000 cm": 3300, "3500 cm": 3800}, selected="3000 cm")
division_3 = Division(A=vão_transversal_p01, B="2")

# ----
# V6
posição_cobertura_p2_p02 = ValueList({"-1650.0", "-1590.0", "-1530.0", "-1470.0", "-1410.0", "-1350.0", "-1290.0", "-1230.0", "-1170.0", "-1110.0"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}, selected="-390.0")
altura_cobertura_p2_p02 = ValueList({"2400.0", "2430.0", "2460.0", "2490.0", "2520.0", "2550.0", "2580.0", "2610.0", "2640.0", "2670.0"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}, selected="2520.0")
multiplication = Multiplication(A=altura_cobertura_p2_p02, B="1")
usar_p2_p02_0_não_1_sim = Slider(0, range=0..1)
pt = ConstructPoint(XCoordinate=posição_cobertura_p2_p02, YCoordinate="0", ZCoordinate=multiplication)
expression = Expression(x=usar_p2_p02_0_não_1_sim, y=pt, z="0", Expression="If(x=1,y,z)")
pt_2 = Point(expression)

# ----
# V7
posição_cobertura_p3_p02 = ValueList({"-1650.0", "-1590.0", "-1530.0", "-1470.0", "-1410.0", "-1350.0", "-1290.0", "-1230.0", "-1170.0", "-1110.0"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}, selected="-390.0")
altura_cobertura_p3_p02 = ValueList({"2400.0", "2430.0", "2460.0", "2490.0", "2520.0", "2550.0", "2580.0", "2610.0", "2640.0", "2670.0"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}, selected="2580.0")
multiplication_2 = Multiplication(A=altura_cobertura_p3_p02, B="1")
usar_p3_p02_0_não_1_sim = Slider(0, range=0..1)
pt_3 = ConstructPoint(XCoordinate=posição_cobertura_p3_p02, YCoordinate="0", ZCoordinate=multiplication_2)
expression_2 = Expression(x=usar_p3_p02_0_não_1_sim, y=pt_3, z="0", Expression="If(x=1,y,z)")
pt_4 = Point(expression_2)

# ----
# V6
posição_cobertura_p2_p01 = ValueList({"-1650.0", "-1590.0", "-1530.0", "-1470.0", "-1410.0", "-1350.0", "-1290.0", "-1230.0", "-1170.0", "-1110.0"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}, selected="-390.0")
altura_cobertura_p2_p01 = ValueList({"2400.0", "2430.0", "2460.0", "2490.0", "2520.0", "2550.0", "2580.0", "2610.0", "2640.0", "2670.0"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}, selected="2520.0")
multiplication_3 = Multiplication(A=altura_cobertura_p2_p01, B="1")
usar_p2_p01_0_não_1_sim = Slider(0, range=0..1)
pt_5 = ConstructPoint(XCoordinate=posição_cobertura_p2_p01, YCoordinate="0", ZCoordinate=multiplication_3)
expression_3 = Expression(x=usar_p2_p01_0_não_1_sim, y=pt_5, z="0", Expression="If(x=1,y,z)")
pt_6 = Point(expression_3)

# ----
# V7
posição_cobertura_p3_p01 = ValueList({"-1650.0", "-1590.0", "-1530.0", "-1470.0", "-1410.0", "-1350.0", "-1290.0", "-1230.0", "-1170.0", "-1110.0"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}, selected="-390.0")
altura_cobertura_p3_p01 = ValueList({"2400.0", "2430.0", "2460.0", "2490.0", "2520.0", "2550.0", "2580.0", "2610.0", "2640.0", "2670.0"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}, selected="2580.0")
multiplication_4 = Multiplication(A=altura_cobertura_p3_p01, B="1")
usar_p3_p01_0_não_1_sim = Slider(0, range=0..1)
pt_7 = ConstructPoint(XCoordinate=posição_cobertura_p3_p01, YCoordinate="0", ZCoordinate=multiplication_4)
expression_4 = Expression(x=usar_p3_p01_0_não_1_sim, y=pt_7, z="0", Expression="If(x=1,y,z)")
pt_8 = Point(expression_4)

# ----
# V6
posição_cobertura_p2_p03 = ValueList({"-1650.0", "-1590.0", "-1530.0", "-1470.0", "-1410.0", "-1350.0", "-1290.0", "-1230.0", "-1170.0", "-1110.0"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}, selected="-390.0")
altura_cobertura_p2_p03 = ValueList({"2400.0", "2430.0", "2460.0", "2490.0", "2520.0", "2550.0", "2580.0", "2610.0", "2640.0", "2670.0"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}, selected="2520.0")
multiplication_5 = Multiplication(A=altura_cobertura_p2_p03, B="1")
usar_p2_p03_0_não_1_sim = Slider(0, range=0..1)
pt_9 = ConstructPoint(XCoordinate=posição_cobertura_p2_p03, YCoordinate="0", ZCoordinate=multiplication_5)
expression_5 = Expression(x=usar_p2_p03_0_não_1_sim, y=pt_9, z="0", Expression="If(x=1,y,z)")
pt_10 = Point(expression_5)

# ----
# V7
posição_cobertura_p3_p03 = ValueList({"-1650.0", "-1590.0", "-1530.0", "-1470.0", "-1410.0", "-1350.0", "-1290.0", "-1230.0", "-1170.0", "-1110.0"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}, selected="-390.0")
altura_cobertura_p3_p03 = ValueList({"2400.0", "2430.0", "2460.0", "2490.0", "2520.0", "2550.0", "2580.0", "2610.0", "2640.0", "2670.0"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}, selected="2580.0")
multiplication_6 = Multiplication(A=altura_cobertura_p3_p03, B="1")
usar_p3_p03_0_não_1_sim = Slider(0, range=0..1)
pt_11 = ConstructPoint(XCoordinate=posição_cobertura_p3_p03, YCoordinate="0", ZCoordinate=multiplication_6)
expression_6 = Expression(x=usar_p3_p03_0_não_1_sim, y=pt_11, z="0", Expression="If(x=1,y,z)")
pt_12 = Point(expression_6)

# ----
# V5
altura_cobertura_p1_p02 = ValueList({"2400.0", "2430.0", "2460.0", "2490.0", "2520.0", "2550.0", "2580.0", "2610.0", "2640.0", "2670.0"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}, selected="2640.0")
posição_cobertura_p1_p02 = ValueList({"-1650.0", "-1590.0", "-1530.0", "-1470.0", "-1410.0", "-1350.0", "-1290.0", "-1230.0", "-1170.0", "-1110.0"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}, selected="-810.0")
multiplication_7 = Multiplication(A=altura_cobertura_p1_p02, B="1")
pt_13 = ConstructPoint(XCoordinate=posição_cobertura_p1_p02, YCoordinate="0", ZCoordinate=multiplication_7)

# ----
# V5
altura_cobertura_p1_p01 = ValueList({"2400.0", "2430.0", "2460.0", "2490.0", "2520.0", "2550.0", "2580.0", "2610.0", "2640.0", "2670.0"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}, selected="3540.0")
posição_cobertura_p1_p01 = ValueList({"-1650.0", "-1590.0", "-1530.0", "-1470.0", "-1410.0", "-1350.0", "-1290.0", "-1230.0", "-1170.0", "-1110.0"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}, selected="-810.0")
multiplication_8 = Multiplication(A=altura_cobertura_p1_p01, B="1")
pt_14 = ConstructPoint(XCoordinate=posição_cobertura_p1_p01, YCoordinate="0", ZCoordinate=multiplication_8)

# ----
# V2
panel = Panel("1")
multiplication_9 = Multiplication(A=division, B=panel)
pt_15 = ConstructPoint(XCoordinate=multiplication_9, YCoordinate="0", ZCoordinate="0")

# ----
# V4
altura_lado_direito_p02 = ValueList({"2400 cm": 2400, "2460 cm": 2460, "2520 cm": 2520, "2580 cm": 2580, "2640 cm": 2640, "2700 cm": 2700, "2760 cm": 2760, "2820 cm": 2820, "2880 cm": 2880, "2940 cm": 2940, "3000 cm": 3000}, selected="2640 cm")
multiplication_10 = Multiplication(A=altura_lado_direito_p02, B="1")
pt_16 = ConstructPoint(XCoordinate=multiplication_9, YCoordinate="0", ZCoordinate=multiplication_10)

# ----
# V5
altura_cobertura_p03 = ValueList({"2400.0", "2430.0", "2460.0", "2490.0", "2520.0", "2550.0", "2580.0", "2610.0", "2640.0", "2670.0"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}, selected="2760.0")
posição_cobertura_p03 = ValueList({"-1650.0", "-1590.0", "-1530.0", "-1470.0", "-1410.0", "-1350.0", "-1290.0", "-1230.0", "-1170.0", "-1110.0"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}, selected="-810.0")
multiplication_11 = Multiplication(A=altura_cobertura_p03, B="1")
pt_17 = ConstructPoint(XCoordinate=posição_cobertura_p03, YCoordinate="0", ZCoordinate=multiplication_11)

# ----
# V2
panel_2 = Panel("1")
multiplication_12 = Multiplication(A=division_3, B=panel_2)
pt_18 = ConstructPoint(XCoordinate=multiplication_12, YCoordinate="0", ZCoordinate="0")

# ----
# V4
altura_lado_direito_p01 = ValueList({"2400 cm": 2400, "2460 cm": 2460, "2520 cm": 2520, "2580 cm": 2580, "2640 cm": 2640, "2700 cm": 2700, "2760 cm": 2760, "2820 cm": 2820, "2880 cm": 2880, "2940 cm": 2940, "3000 cm": 3000}, selected="2400 cm")
multiplication_13 = Multiplication(A=altura_lado_direito_p01, B="1")
pt_19 = ConstructPoint(XCoordinate=multiplication_12, YCoordinate="0", ZCoordinate=multiplication_13)

# ----
# V2
panel_3 = Panel("1")
multiplication_14 = Multiplication(A=division_2, B=panel_3)
pt_20 = ConstructPoint(XCoordinate=multiplication_14, YCoordinate="0", ZCoordinate="0")

# ----
# V4
altura_lado_direito_p03 = ValueList({"2400 cm": 2400, "2460 cm": 2460, "2520 cm": 2520, "2580 cm": 2580, "2640 cm": 2640, "2700 cm": 2700, "2760 cm": 2760, "2820 cm": 2820, "2880 cm": 2880, "2940 cm": 2940, "3000 cm": 3000}, selected="2640 cm")
multiplication_15 = Multiplication(A=altura_lado_direito_p03, B="1")
pt_21 = ConstructPoint(XCoordinate=multiplication_14, YCoordinate="0", ZCoordinate=multiplication_15)

# ----
# V1
panel_4 = Panel("-1")
multiplication_16 = Multiplication(A=division, B=panel_4)
pt_22 = ConstructPoint(XCoordinate=multiplication_16, YCoordinate="0", ZCoordinate="0")

# ----
# V3
altura_lado_esquerdo_p02 = ValueList({"2400 cm": 2400, "2460 cm": 2460, "2520 cm": 2520, "2580 cm": 2580, "2640 cm": 2640, "2700 cm": 2700, "2760 cm": 2760, "2820 cm": 2820, "2880 cm": 2880, "2940 cm": 2940, "3000 cm": 3000}, selected="2640 cm")
multiplication_17 = Multiplication(A=altura_lado_esquerdo_p02, B="1")
pt_23 = ConstructPoint(XCoordinate=multiplication_16, YCoordinate="0", ZCoordinate=multiplication_17)

# ----
# V1
panel_5 = Panel("-1")
multiplication_18 = Multiplication(A=division_3, B=panel_5)
pt_24 = ConstructPoint(XCoordinate=multiplication_18, YCoordinate="0", ZCoordinate="0")

# ----
# V3
altura_lado_esquerdo_p01 = ValueList({"2400 cm": 2400, "2460 cm": 2460, "2520 cm": 2520, "2580 cm": 2580, "2640 cm": 2640, "2700 cm": 2700, "2760 cm": 2760, "2820 cm": 2820, "2880 cm": 2880, "2940 cm": 2940, "3000 cm": 3000}, selected="2760 cm")
multiplication_19 = Multiplication(A=altura_lado_esquerdo_p01, B="1")
pt_25 = ConstructPoint(XCoordinate=multiplication_18, YCoordinate="0", ZCoordinate=multiplication_19)

# ----
# V1
panel_6 = Panel("-1")
multiplication_20 = Multiplication(A=division_2, B=panel_6)
pt_26 = ConstructPoint(XCoordinate=multiplication_20, YCoordinate="0", ZCoordinate="0")

# ----
# V3
altura_lado_esquerdo_p03 = ValueList({"2400 cm": 2400, "2460 cm": 2460, "2520 cm": 2520, "2580 cm": 2580, "2640 cm": 2640, "2700 cm": 2700, "2760 cm": 2760, "2820 cm": 2820, "2880 cm": 2880, "2940 cm": 2940, "3000 cm": 3000}, selected="2640 cm")
multiplication_21 = Multiplication(A=altura_lado_esquerdo_p03, B="1")
pt_27 = ConstructPoint(XCoordinate=multiplication_20, YCoordinate="0", ZCoordinate=multiplication_21)

ln = Line(StartPoint=pt_23, EndPoint=pt_22)
ln_2 = Line(StartPoint=pt_15, EndPoint=pt_16)
curvepoint = PointOnCurve(ln, parameter=0.75)
curvepoint_2 = PointOnCurve(ln_2, parameter=0.75)

ln_3 = Line(StartPoint=pt_23, EndPoint=pt_22)
ln_4 = Line(StartPoint=pt_15, EndPoint=pt_16)
curvepoint_3 = PointOnCurve(ln_3, parameter=0.25)
curvepoint_4 = PointOnCurve(ln_4, parameter=0.25)

ln_5 = Line(StartPoint=pt_13, EndPoint=pt_23)
ln_6 = Line(StartPoint=pt_16, EndPoint=pt_13)
curvepoint_5 = PointOnCurve(ln_5, parameter=0.5)
curvepoint_6 = PointOnCurve(ln_6, parameter=0.75)

ln_7 = Line(StartPoint=pt_25, EndPoint=pt_24)
ln_8 = Line(StartPoint=pt_18, EndPoint=pt_19)
curvepoint_7 = PointOnCurve(ln_7, parameter=0.75)
curvepoint_8 = PointOnCurve(ln_8, parameter=0.75)

ln_9 = Line(StartPoint=pt_25, EndPoint=pt_24)
ln_10 = Line(StartPoint=pt_18, EndPoint=pt_19)
curvepoint_9 = PointOnCurve(ln_9, parameter=0.25)
curvepoint_10 = PointOnCurve(ln_10, parameter=0.25)

ln_11 = Line(StartPoint=pt_14, EndPoint=pt_25)
ln_12 = Line(StartPoint=pt_19, EndPoint=pt_14)
curvepoint_11 = PointOnCurve(ln_11, parameter=0.5)
curvepoint_12 = PointOnCurve(ln_12, parameter=0.75)

ln_13 = Line(StartPoint=pt_23, EndPoint=pt_2)
ln_14 = Line(StartPoint=pt_13, EndPoint=pt_2)
ln_15 = Line(StartPoint=pt_16, EndPoint=pt_13)
curvepoint_13 = PointOnCurve(ln_13, parameter=0.5)
curvepoint_14 = PointOnCurve(ln_14, parameter=0.5)
curvepoint_15 = PointOnCurve(ln_15, parameter=0.5)

ln_16 = Line(StartPoint=pt_25, EndPoint=pt_6)
ln_17 = Line(StartPoint=pt_14, EndPoint=pt_6)
ln_18 = Line(StartPoint=pt_19, EndPoint=pt_14)
curvepoint_16 = PointOnCurve(ln_16, parameter=0.5)
curvepoint_17 = PointOnCurve(ln_17, parameter=0.5)
curvepoint_18 = PointOnCurve(ln_18, parameter=0.5)

ln_19 = Line(StartPoint=pt_27, EndPoint=pt_26)
ln_20 = Line(StartPoint=pt_20, EndPoint=pt_21)
curvepoint_19 = PointOnCurve(ln_19, parameter=0.75)
curvepoint_20 = PointOnCurve(ln_20, parameter=0.75)

ln_21 = Line(StartPoint=pt_27, EndPoint=pt_26)
ln_22 = Line(StartPoint=pt_20, EndPoint=pt_21)
curvepoint_21 = PointOnCurve(ln_21, parameter=0.25)
curvepoint_22 = PointOnCurve(ln_22, parameter=0.25)

ln_23 = Line(StartPoint=pt_17, EndPoint=pt_27)
ln_24 = Line(StartPoint=pt_21, EndPoint=pt_17)
curvepoint_23 = PointOnCurve(ln_23, parameter=0.5)
curvepoint_24 = PointOnCurve(ln_24, parameter=0.75)

ln_25 = Line(StartPoint=pt_27, EndPoint=pt_10)
ln_26 = Line(StartPoint=pt_17, EndPoint=pt_10)
ln_27 = Line(StartPoint=pt_21, EndPoint=pt_17)
curvepoint_25 = PointOnCurve(ln_25, parameter=0.5)
curvepoint_26 = PointOnCurve(ln_26, parameter=0.5)
curvepoint_27 = PointOnCurve(ln_27, parameter=0.5)

# ----
# PERFIL 02 (P02)
pt_28 = Point([curvepoint_6, curvepoint_5])
pt_29 = Point([curvepoint_13, curvepoint_14, curvepoint_15])
filter = StreamFilter(Gate=usar_p2_p02_0_não_1_sim, Stream0=pt_28, Stream1=pt_29)
nurbs = NurbsCurve(Vertices=[pt_4, pt_2, pt_13, pt_16, pt_15, pt_22, pt_23], Degree=1, Periodic=True)  # -> Curve, Length, Domain

# ----
# PERFIL 03 (P03)
pt_30 = Point([curvepoint_24, curvepoint_23])
pt_31 = Point([curvepoint_25, curvepoint_26, curvepoint_27])
filter_2 = StreamFilter(Gate=usar_p2_p03_0_não_1_sim, Stream0=pt_30, Stream1=pt_31)
nurbs_2 = NurbsCurve(Vertices=[pt_12, pt_10, pt_17, pt_21, pt_20, pt_26, pt_27], Degree=1, Periodic=True)  # -> Curve, Length, Domain

# ----
# DEFINIÇÃO DO PERFIL
# 1- escolher a curva;
# 2- definir largura;
largura_do_perfil_p02 = ValueList({"100 mm": "100.0", "110 mm": "110.0", "120 mm": "120.0", "130 mm": "130.0", "140 mm": "140.0", "150 mm": "150.0", "160 mm": "160.0", "170 mm": "170.0", "180 mm": "180.0", "190 mm": "190.0"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}, selected="300 mm": "300.0")
division_4 = Division(A=largura_do_perfil_p02, B="2")
multiplication_22 = Multiplication(A=division_4, B="-1")
crv = Curve(nurbs.Curve)

# ----
# DEFINIÇÃO DO PERFIL
# 1- escolher a curva;
# 2- definir largura;
largura_do_perfil_p03 = ValueList({"100 mm": "100.0", "110 mm": "110.0", "120 mm": "120.0", "130 mm": "130.0", "140 mm": "140.0", "150 mm": "150.0", "160 mm": "160.0", "170 mm": "170.0", "180 mm": "180.0", "190 mm": "190.0"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}, selected="300 mm": "300.0")
division_5 = Division(A=largura_do_perfil_p03, B="2")
multiplication_23 = Multiplication(A=division_5, B="-1")
crv_2 = Curve(nurbs_2.Curve)

# ----
# OFFSET P/ DEFINIR LARG.
# CURVA -> SUPERFÍCIE
offset = Offset(Curve=crv, Distance=division_4, Plane=PlaneXY(0, 0, 0), Corners=1)
offset_2 = Offset(Curve=crv, Distance=multiplication_22, Plane=PlaneXY(0, 0, 0), Corners=1)
offset_perfil_externo = Curve(offset_2)
offset_perfil_interno = Curve(offset)
join = JoinCurves(Curves=flatten([offset_perfil_externo, offset_perfil_interno]), Preserve=False)
boundary = BoundarySurfaces(Edges=flatten(join))

# ----
# CURVA -> SUPERFÍCIE
# OFFSET P/ DEFINIR LARG.
offset_3 = Offset(Curve=crv_2, Distance=division_5, Plane=PlaneXY(0, 0, 0), Corners=1)
offset_4 = Offset(Curve=crv_2, Distance=multiplication_23, Plane=PlaneXY(0, 0, 0), Corners=1)
offset_perfil_externo_2 = Curve(offset_4)
offset_perfil_interno_2 = Curve(offset_3)
join_2 = JoinCurves(Curves=flatten([offset_perfil_externo_2, offset_perfil_interno_2]), Preserve=False)
boundary_2 = BoundarySurfaces(Edges=flatten(join_2))

offset_5 = Offset(Curve=offset_perfil_interno, Distance=-23, Plane=PlaneXY(0, 0, 0), Corners=1)
offset_6 = Offset(Curve=offset_perfil_interno_2, Distance=-23, Plane=PlaneXY(0, 0, 0), Corners=1)
adição_lateral_comum_p03 = ValueList({"Posição 1": 0, "Posição 2": 0.150, "Posição 3": 0.300, "Posição 4": 0.550, "Posição 5": 0.700, "Posição 6": 0.850}, selected="Posição 1")
mov_adição_bilateral_90º_p02 = ValueList({"Posição 1": 0, "Posição 2": 0.250, "Posição 3": 0.500, "Posição 4": 0.750, "Posição 5": 1.00}, selected="Posição 4")
mov_adição_lateral_90º_p02 = ValueList({"Posição 1": 0, "Posição 2": 0.250, "Posição 3": 0.500, "Posição 4": 0.750, "Posição 5": 1.00}, selected="Posição 3")
mov_adição_em_h_90º_p02 = ValueList({"Posição 1": 0, "Posição 2": 0.250, "Posição 3": 0.500, "Posição 4": 0.750, "Posição 5": 1.00}, selected="Posição 4")
mov_adição_cruciforme_90º_p02 = ValueList({"Posição 1": 0, "Posição 2": 0.250, "Posição 3": 0.500, "Posição 4": 0.750, "Posição 5": 1.00}, selected="Posição 2")
mov_adição_cruciforme_90º_p03 = ValueList({"Posição 1": 0, "Posição 2": 0.250, "Posição 3": 0.500, "Posição 4": 0.750, "Posição 5": 1.00}, selected="Posição 4")
mov_adição_em_o_90º_p02 = ValueList({"Posição 1": 0.750, "Posição 2": 0.850, "Posição 3": 0.900, "Posição 4": 0.950, "Posição 5": 1}, selected="Posição 5")
mov_adição_em_o_90º_p03 = ValueList({"Posição 1": 0, "Posição 2": 0.100, "Posição 3": 0.150, "Posição 4": 0.200, "Posição 5": 0.250}, selected="Posição 5")
geo = Geometry(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)

preço_por_metro_quadrado = Panel("400")

Y = UnitY(Factor=750)
comprimento_total = Panel("PERFIL")
X = UnitX(Factor=5500)
X_2 = UnitX(Factor=9000)
X_3 = UnitX(Factor=12000)
X_4 = UnitX(Factor=15500)

# ----
# SHAPEDIVER
panel_7 = Panel("https://i.imgur.com/EHYp432.png")
sdimageinput = ShapeDiverImageInput(URI=panel_7, maximum_file_size=10485760, selected_file_formats="image/png")  # -> Bitmap, Width, Height
rectangle = Rectangle(Plane=PlaneXY(0, 0, 0), XSize=sdimageinput.Width, YSize=sdimageinput.Height, Radius=0)  # -> Rectangle, Length
mplane = MeshPlane(Boundary=rectangle.Rectangle, WidthCount=10, HeightCount=10)  # -> Mesh, Area
Y_2 = UnitY(Factor=-9950)
move = Move(Geometry=mplane.Mesh, Motion=Y_2)  # -> Geometry, Transform
X_5 = UnitX(Factor=-23500)
move_2 = Move(Geometry=move.Geometry, Motion=X_5)  # -> Geometry, Transform
pt_32 = Point(Point(-25109, -10119, 0))
sdmaterial = ShapeDiverMaterial(Color=RGB(255, 255, 255), Texture=sdimageinput.Bitmap, FlatShading=False)
scale = Scale(Geometry=move_2.Geometry, Center=pt_32, Factor=2.5)  # -> Geometry, Transform
sddisplaygeometry = ShapeDiverDisplayGeometry(Geometry=scale.Geometry, ShapeDiverMaterial=sdmaterial)

# ----
# CONECTORES HORIZONTAIS
multiplication_24 = Multiplication(A=largura_do_perfil_p02, B=-1)
explode = Explode(Curve=offset_perfil_interno, Recursive=True)  # -> Segments, Vertices
item = ListItem(List=explode.Segments, Index=2, Wrap=True)
divide = DivideCurve(Curve=item, Count=5, Kinks=True)  # -> Points, Tangents, Parameters
Z = UnitZ(Factor=multiplication_24)
move_3 = Move(Geometry=divide.Points, Motion=Z)  # -> Geometry, Transform
pt_33 = Point([curvepoint, curvepoint_2, curvepoint_4, curvepoint_3, filter])
line = Line(StartPoint=divide.Points, EndPoint=move_3.Geometry)
curve_closest_point = CurveClosestPoint(Point=pt_33, Curve=offset_perfil_externo)  # -> flatten(Point), Parameter, Distance
curve_closest_point_2 = CurveClosestPoint(Point=pt_33, Curve=offset_perfil_interno)  # -> flatten(Point), Parameter, Distance
cp = ClosestPoint(Point=curve_closest_point.Point, Cloud=curve_closest_point_2.Point)  # -> ClosestPoint, CPIndex, Distance
line_2 = Line(StartPoint=curve_closest_point.Point, EndPoint=cp.ClosestPoint)
end_points = EndPoints(Curve=line)  # -> flatten(Start), flatten(End)
end_points_2 = EndPoints(Curve=line_2)  # -> flatten(Start), flatten(End)

# ----
# CONECTORES HORIZONTAIS
multiplication_25 = Multiplication(A=[largura_do_perfil_p02, largura_do_perfil_p03], B=-1)
explode_2 = Explode(Curve=offset_perfil_interno_2, Recursive=True)  # -> Segments, Vertices
item_2 = ListItem(List=explode_2.Segments, Index=2, Wrap=True)
divide_2 = DivideCurve(Curve=item_2, Count=5, Kinks=True)  # -> Points, Tangents, Parameters
Z_2 = UnitZ(Factor=multiplication_25)
move_4 = Move(Geometry=divide_2.Points, Motion=Z_2)  # -> Geometry, Transform
pt_34 = Point([curvepoint_19, curvepoint_20, curvepoint_22, curvepoint_21, filter_2])
line_3 = Line(StartPoint=divide_2.Points, EndPoint=move_4.Geometry)
curve_closest_point_3 = CurveClosestPoint(Point=pt_34, Curve=offset_perfil_interno_2)  # -> flatten(Point), Parameter, Distance
curve_closest_point_4 = CurveClosestPoint(Point=pt_34, Curve=offset_perfil_externo_2)  # -> flatten(Point), Parameter, Distance
cp_2 = ClosestPoint(Point=curve_closest_point_3.Point, Cloud=curve_closest_point_4.Point)  # -> ClosestPoint, CPIndex, Distance
line_4 = Line(StartPoint=curve_closest_point_3.Point, EndPoint=cp_2.ClosestPoint)
end_points_3 = EndPoints(Curve=line_3)  # -> flatten(Start), flatten(End)
end_points_4 = EndPoints(Curve=line_4)  # -> flatten(Start), flatten(End)

# ----
# CONECTORES HORIZONTAIS
pt_35 = Point([curvepoint_12, curvepoint_11])
pt_36 = Point([curvepoint_16, curvepoint_17, curvepoint_18])
filter_3 = StreamFilter(Gate=usar_p2_p01_0_não_1_sim, Stream0=pt_35, Stream1=pt_36)
pt_37 = Point([curvepoint_7, curvepoint_8, curvepoint_10, curvepoint_9, filter_3])

# ----
# PERFIL 01 (P01)
nurbs_3 = NurbsCurve(Vertices=[pt_25, pt_24, pt_18, pt_19, pt_14, pt_6, pt_8], Degree=1, Periodic=True)  # -> Curve, Length, Domain

# ----
# DEFINIÇÃO DO PERFIL
# 1- escolher a curva;
# 2- definir largura;
largura_do_perfil_p01 = ValueList({"100 mm": "100.0", "110 mm": "110.0", "120 mm": "120.0", "130 mm": "130.0", "140 mm": "140.0", "150 mm": "150.0", "160 mm": "160.0", "170 mm": "170.0", "180 mm": "180.0", "190 mm": "190.0"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}, selected="300 mm": "300.0")
division_6 = Division(A=largura_do_perfil_p01, B="2")
multiplication_26 = Multiplication(A=division_6, B="-1")
crv_3 = Curve(nurbs_3.Curve)

# ----
# OFFSET P/ DEFINIR LARG.
# CURVA -> SUPERFÍCIE
offset_7 = Offset(Curve=crv_3, Distance=division_6, Plane=PlaneXY(0, 0, 0), Corners=1)
offset_8 = Offset(Curve=crv_3, Distance=multiplication_26, Plane=PlaneXY(0, 0, 0), Corners=1)
offset_perfil_externo_3 = Curve(offset_7)
offset_perfil_interno_3 = Curve(offset_8)
join_3 = JoinCurves(Curves=flatten([offset_perfil_interno_3, offset_perfil_externo_3]), Preserve=False)
boundary_3 = BoundarySurfaces(Edges=flatten(join_3))

offset_9 = Offset(Curve=offset_perfil_interno_3, Distance=-23, Plane=PlaneXY(0, 0, 0), Corners=1)

multiplication_27 = Multiplication(A=largura_do_perfil_p01, B=-1)
explode_3 = Explode(Curve=offset_perfil_interno_3, Recursive=True)  # -> Segments, Vertices
item_3 = ListItem(List=explode_3.Segments, Index=1, Wrap=True)
divide_3 = DivideCurve(Curve=item_3, Count=5, Kinks=True)  # -> Points, Tangents, Parameters
Z_3 = UnitZ(Factor=multiplication_27)
move_5 = Move(Geometry=divide_3.Points, Motion=Z_3)  # -> Geometry, Transform
line_5 = Line(StartPoint=divide_3.Points, EndPoint=move_5.Geometry)
curve_closest_point_5 = CurveClosestPoint(Point=pt_37, Curve=offset_perfil_interno_3)  # -> flatten(Point), Parameter, Distance
curve_closest_point_6 = CurveClosestPoint(Point=pt_37, Curve=offset_perfil_externo_3)  # -> flatten(Point), Parameter, Distance
cp_3 = ClosestPoint(Point=curve_closest_point_5.Point, Cloud=curve_closest_point_6.Point)  # -> ClosestPoint, CPIndex, Distance
line_6 = Line(StartPoint=curve_closest_point_5.Point, EndPoint=cp_3.ClosestPoint)
end_points_5 = EndPoints(Curve=line_5)  # -> flatten(Start), flatten(End)
end_points_6 = EndPoints(Curve=line_6)  # -> flatten(Start), flatten(End)

offset_perfil_externo_4 = Curve(offset_7)
offset_perfil_interno_4 = Curve(offset_8)
offset_10 = Offset(Curve=offset_perfil_externo_4, Distance="18", Plane=PlaneXY(0, 0, 0), Corners=1)
join_4 = JoinCurves(Curves=flatten([offset_10, offset_perfil_externo_4]), Preserve=False)
boundary_4 = BoundarySurfaces(Edges=flatten(join_4))

offset_perfil_interno_5 = Curve(offset_perfil_interno)
offset_perfil_externo_5 = Curve(offset_perfil_externo)
offset_11 = Offset(Curve=offset_perfil_interno_5, Distance="18", Plane=PlaneXY(0, 0, 0), Corners=1)
join_5 = JoinCurves(Curves=flatten([offset_11, offset_perfil_interno_5]), Preserve=False)
boundary_5 = BoundarySurfaces(Edges=flatten(join_5))

multiplication_28 = Multiplication(A="18", B=-1)

offset_perfil_interno_6 = Curve(offset_perfil_interno_2)
offset_perfil_externo_6 = Curve(offset_perfil_externo_2)
offset_12 = Offset(Curve=offset_perfil_interno_6, Distance="18", Plane=PlaneXY(0, 0, 0), Corners=1)
join_6 = JoinCurves(Curves=flatten([offset_12, offset_perfil_interno_6]), Preserve=False)
boundary_6 = BoundarySurfaces(Edges=flatten(join_6))

multiplication_29 = Multiplication(A="18", B=-1)

multiplication_30 = Multiplication(A="18", B=-1)

offset_13 = Offset(Curve=offset_perfil_externo_5, Distance=multiplication_28, Plane=PlaneXY(0, 0, 0), Corners=1)
join_7 = JoinCurves(Curves=flatten([offset_13, offset_perfil_externo_5]), Preserve=False)
boundary_7 = BoundarySurfaces(Edges=flatten(join_7))

offset_14 = Offset(Curve=offset_perfil_interno_4, Distance=multiplication_30, Plane=PlaneXY(0, 0, 0), Corners=1)
join_8 = JoinCurves(Curves=flatten([offset_14, offset_perfil_interno_4]), Preserve=False)
boundary_8 = BoundarySurfaces(Edges=flatten(join_8))

offset_15 = Offset(Curve=offset_perfil_externo_6, Distance=multiplication_29, Plane=PlaneXY(0, 0, 0), Corners=1)
join_9 = JoinCurves(Curves=flatten([offset_15, offset_perfil_externo_6]), Preserve=False)
boundary_9 = BoundarySurfaces(Edges=flatten(join_9))

# ----
# DEFINIÇÃO DA
# ESPESSURA DA
# PEÇA
espessura_dos_perfis = ValueList({"10 mm": 10, "12 mm": 12, "14 mm": 14, "16 mm": 16, "18 mm": 18, "20 mm": 20, "24 mm": 24, "30 mm": 30, "36 mm": 36}, selected="36 mm")
multiplication_31 = Multiplication(A=espessura_dos_perfis, B=-1)
Y_3 = UnitY(Factor=espessura_dos_perfis)
extr = Extrude(Base=boundary_2, Direction=Y_3)
extr_2 = Extrude(Base=boundary, Direction=Y_3)
extr_3 = Extrude(Base=boundary_3, Direction=Y_3)
dup = DuplicateData(Data=extr, Number=1, Order=True)
dup_2 = DuplicateData(Data=extr_2, Number=1, Order=True)
dup_3 = DuplicateData(Data=extr_3, Number=1, Order=True)

addition = Addition(A=espessura_dos_perfis, B=0)

panel_8 = Panel(espessura_dos_perfis)
offset_16 = Offset(Curve=line, Distance=panel_8, Plane=Plane(origin=(0, 0, 0), x=(0, 0, 1), y=(1, 0, 0)), Corners=1)  # -> flatten(Curve)
offset_17 = Offset(Curve=line_2, Distance=panel_8, Plane=Plane(origin=(0, 0, 0), x=(0, 0, 1), y=(1, 0, 0)), Corners=1)  # -> flatten(Curve)
end_points_7 = EndPoints(Curve=offset_16)  # -> flatten(Start), flatten(End)
end_points_8 = EndPoints(Curve=offset_17)  # -> flatten(Start), flatten(End)
prox = Proximity3D(Points=[end_points_7.Start, end_points_7.End, end_points.Start, end_points.End], Group=2, MinRadius=0, MaxRadius=350)  # -> Links, Topology
prox_2 = Proximity3D(Points=[end_points_8.Start, end_points_8.End, end_points_2.Start, end_points_2.End], Group=2, MinRadius=0, MaxRadius=350)  # -> Links, Topology

panel_9 = Panel(espessura_dos_perfis)
offset_18 = Offset(Curve=line_5, Distance=panel_9, Plane=Plane(origin=(0, 0, 0), x=(0, 0, 1), y=(1, 0, 0)), Corners=1)  # -> flatten(Curve)
offset_19 = Offset(Curve=line_6, Distance=panel_9, Plane=Plane(origin=(0, 0, 0), x=(0, 0, 1), y=(1, 0, 0)), Corners=1)  # -> flatten(Curve)
end_points_9 = EndPoints(Curve=offset_18)  # -> flatten(Start), flatten(End)
end_points_10 = EndPoints(Curve=offset_19)  # -> flatten(Start), flatten(End)
prox_3 = Proximity3D(Points=[end_points_9.Start, end_points_9.End, end_points_5.Start, end_points_5.End], Group=2, MinRadius=0, MaxRadius=350)  # -> Links, Topology
prox_4 = Proximity3D(
    Points=[end_points_10.Start, end_points_10.End, end_points_6.Start, end_points_6.End],
    Group=2,
    MinRadius=0,
    MaxRadius=350)  # -> Links, Topology

panel_10 = Panel(espessura_dos_perfis)
offset_20 = Offset(Curve=line_3, Distance=panel_10, Plane=Plane(origin=(0, 0, 0), x=(0, 0, 1), y=(1, 0, 0)), Corners=1)  # -> flatten(Curve)
offset_21 = Offset(Curve=line_4, Distance=panel_10, Plane=Plane(origin=(0, 0, 0), x=(0, 0, 1), y=(1, 0, 0)), Corners=1)  # -> flatten(Curve)
end_points_11 = EndPoints(Curve=offset_20)  # -> flatten(Start), flatten(End)
end_points_12 = EndPoints(Curve=offset_21)  # -> flatten(Start), flatten(End)
prox_5 = Proximity3D(
    Points=[end_points_11.Start, end_points_11.End, end_points_3.Start, end_points_3.End],
    Group=2,
    MinRadius=0,
    MaxRadius=350)  # -> Links, Topology
prox_6 = Proximity3D(
    Points=[end_points_12.Start, end_points_12.End, end_points_4.Start, end_points_4.End],
    Group=2,
    MinRadius=0,
    MaxRadius=350)  # -> Links, Topology

# ----
# MÓDULOS E VÃO ENTRE MÓDULOS
# 1 - Definir Nº de Módulos
# 2 - Definir vão entre módulos
nº_de_módulos_p01 = Slider(8, range=1..25)
vão_longitudinal = ValueList({"50 cm": 500, "70 cm": 700, "100 cm": 1000, "120 cm": 1200, "150 cm": 1500}, selected="150 cm")
multiplication_32 = Multiplication(A=vão_longitudinal, B="2")
multiplication_33 = Multiplication(A=multiplication_32, B=nº_de_módulos_p01)
division_7 = Division(A=multiplication_32, B="2")
multiplication_34 = Multiplication(A=espessura_dos_perfis, B=-1)
division_8 = Division(A=multiplication_33, B="2")
addition_2 = Addition(A=division_7, B=multiplication_34)
Y_4 = UnitY(Factor=addition_2)
panel_11 = Panel(nº_de_módulos_p01)

addition_3 = Addition(A=vão_longitudinal, B=-10)

addition_4 = Addition(A=vão_longitudinal, B=-10)

addition_5 = Addition(A=vão_longitudinal, B=-10)

Y_5 = UnitY(Factor=vão_longitudinal)
extr_4 = Extrude(Base=[prox_4.Links, prox_3.Links], Direction=Y_5)

Y_6 = UnitY(Factor=vão_longitudinal)
extr_5 = Extrude(Base=[prox_2.Links, prox.Links], Direction=Y_6)

Y_7 = UnitY(Factor=vão_longitudinal)
extr_6 = Extrude(Base=[prox_6.Links, prox_5.Links], Direction=Y_7)

Y_8 = UnitY(Factor=addition_4)
extr_7 = Extrude(Base=[boundary_4, boundary_8], Direction=Y_8)

Y_9 = UnitY(Factor=addition_3)
extr_8 = Extrude(Base=[boundary_5, boundary_7], Direction=Y_9)

Y_10 = UnitY(Factor=addition_5)
extr_9 = Extrude(Base=[boundary_6, boundary_9], Direction=Y_10)

addition_6 = Addition(A=vão_longitudinal, B=multiplication_31)
Y_11 = UnitY(Factor=addition_6)
move_6 = Move(Geometry=dup, Motion=Y_11)  # -> Geometry, Transform
move_7 = Move(Geometry=dup_2, Motion=Y_11)  # -> Geometry, Transform
move_8 = Move(Geometry=dup_3, Motion=Y_11)  # -> Geometry, Transform

# ----
# FECHAMENTO
# INTERNO/EXTERNO
fechamento_interno_externo = Slider(0, range=0..1)
gate = StreamGate(Stream=extr_9, Gate=fechamento_interno_externo)  # -> Target0, simplify(Target1)
gate_2 = StreamGate(Stream=extr_8, Gate=fechamento_interno_externo)  # -> Target0, simplify(Target1)
gate_3 = StreamGate(Stream=extr_7, Gate=fechamento_interno_externo)  # -> Target0, simplify(Target1)

# ----
# CONECTORES
# HORIZONTAIS
conectores_horizontais = Slider(1, range=0..1)
gate_4 = StreamGate(Stream=extr_6, Gate=conectores_horizontais)  # -> Target0, simplify(Target1)
gate_5 = StreamGate(Stream=extr_5, Gate=conectores_horizontais)  # -> Target0, flatten(Target1)
gate_6 = StreamGate(Stream=extr_4, Gate=conectores_horizontais)  # -> Target0, flatten(Target1)

join_10 = BrepJoin(Breps=[gate_4.Target1, gate.Target1])  # -> Breps, Closed
join_11 = BrepJoin(Breps=[gate_5.Target1, gate_2.Target1])  # -> Breps, Closed
join_12 = BrepJoin(Breps=[gate_6.Target1, gate_3.Target1])  # -> Breps, Closed

nº_de_módulos_p02 = Slider(6, range=1..25)
nº_de_módulos_p03 = Slider(8, range=1..25)
arrlinear = LinearArray(Geometry=[extr, move_6.Geometry, gate.Target1, join_10.Breps], Direction=Y_4, Count=nº_de_módulos_p03)  # -> flatten(Geometry), Transform
arrlinear_2 = LinearArray(Geometry=[extr_2, move_7.Geometry, join_11.Breps], Direction=Y_4, Count=nº_de_módulos_p02)  # -> flatten(Geometry), Transform
arrlinear_3 = LinearArray(Geometry=[move_8.Geometry, extr_3, join_12.Breps], Direction=Y_4, Count=panel_11)  # -> flatten(Geometry), Transform
brep = Brep(arrlinear_3.Geometry)
group = Group(Objects=brep)
bbox = BoundingBox(Content=arrlinear.Geometry, Plane=PlaneXY(0, 0, 0), UnionBox=True)  # -> Box, Box_2
bbox_2 = BoundingBox(Content=arrlinear_2.Geometry, Plane=PlaneXY(0, 0, 0), UnionBox=True)  # -> Box, Box_2
bbox_3 = BoundingBox(Content=group, Plane=PlaneXY(0, 0, 0), UnionBox=True)  # -> Box, Box_2
debox = DeconstructBox(Box=bbox.Box)  # -> Plane, X, Y, Z
debox_2 = DeconstructBox(Box=bbox_2.Box)  # -> Plane, X, Y, Z
debox_3 = DeconstructBox(Box=bbox_3.Box)  # -> Plane, X, Y, Z
num = Number(debox.Y)
num_2 = Number(debox_2.Y)
num_3 = Number(debox_3.Y)

comp_total = Panel(num_3)

multiplication_35 = Multiplication(A=multiplication_32, B=nº_de_módulos_p03)
multiplication_36 = Multiplication(A=multiplication_32, B=nº_de_módulos_p02)
boundary_10 = BoundarySurfaces(Edges=offset_6)
boundary_11 = BoundarySurfaces(Edges=offset_5)
boundary_12 = BoundarySurfaces(Edges=offset_9)
division_9 = Division(A=multiplication_35, B="2")
division_10 = Division(A=multiplication_36, B="2")
multiplication_37 = Multiplication(A=espessura_dos_perfis, B=-1)
Y_12 = UnitY(Factor=addition)
multiplication_38 = Multiplication(A=espessura_dos_perfis, B=-1)
multiplication_39 = Multiplication(A=espessura_dos_perfis, B=-1)
comp_total_2 = Panel(num)
comp_total_3 = Panel(num_2)
extr_10 = Extrude(Base=boundary_10, Direction=Y_12)
extr_11 = Extrude(Base=boundary_11, Direction=Y_12)
extr_12 = Extrude(Base=boundary_12, Direction=Y_12)
addition_7 = Addition(A=comp_total, B=multiplication_37)
addition_8 = Addition(A=comp_total_2, B=multiplication_38)
addition_9 = Addition(A=comp_total_3, B=multiplication_39)
dup_4 = DuplicateData(Data=extr_10, Number=1, Order=True)
Y_13 = UnitY(Factor=addition_8)
dup_5 = DuplicateData(Data=extr_11, Number=1, Order=True)
Y_14 = UnitY(Factor=addition_9)
dup_6 = DuplicateData(Data=extr_12, Number=1, Order=True)
Y_15 = UnitY(Factor=addition_7)
move_9 = Move(Geometry=dup_4, Motion=Y_13)  # -> Geometry, Transform
move_10 = Move(Geometry=dup_5, Motion=Y_14)  # -> Geometry, Transform
move_11 = Move(Geometry=dup_6, Motion=Y_15)  # -> Geometry, Transform

# ----
# ADIÇÃO EM "O" 90º
nº_de_módulos_p04 = Slider(3, range=1..25)
addition_10 = Addition(A=espessura_dos_perfis, B=0)
offset_22 = Offset(Curve=offset_perfil_interno_3, Distance=-23, Plane=PlaneXY(0, 0, 0), Corners=1)
smaller = SmallerThan(FirstNumber=nº_de_módulos_p04, SecondNumber=nº_de_módulos_p01)  # -> SmallerThan, OrEqualTo
boundary_13 = BoundarySurfaces(Edges=offset_22)
gate_7 = StreamGate(Stream=nº_de_módulos_p04, Gate=smaller.OrEqualTo)  # -> Target0, Target1
multiplication_40 = Multiplication(A=espessura_dos_perfis, B=-1)
Y_16 = UnitY(Factor=addition_10)
extr_13 = Extrude(Base=boundary_13, Direction=Y_16)  # -> flatten(Extrusion)
area = Area(Geometry=bbox_3.Box)  # -> Area, Centroid
dup_7 = DuplicateData(Data=extr_13, Number=1, Order=True)
debox_4 = DeconstructBox(Box=bbox_3.Box)  # -> Plane, X, Y, Z
num_4 = Number(debox_4.X)
num_5 = Number(debox_4.Y)
division_11 = Division(A=num_4, B=2)
division_12 = Division(A=num_5, B=2)
addition_11 = Addition(A=division_12, B=division_11)
X_6 = UnitX(Factor=addition_11)
multiplication_41 = Multiplication(A=X_6, B=-1)
num_6 = Number(debox_4.Y)
num_7 = Number(debox_4.Y)

arrlinear_4 = LinearArray(Geometry=[move_8.Geometry, extr_3, join_12.Breps], Direction=Y_4, Count=gate_7.Target1)  # -> flatten(Geometry), Transform
bbox_4 = BoundingBox(Content=arrlinear_4.Geometry, Plane=PlaneXY(0, 0, 0), UnionBox=True)  # -> Box, Box_2

# ----
# ADIÇÃO LATERAL
# COMUM
addition_12 = Addition(A=largura_do_perfil_p01, B=vão_transversal_p01)
debox_5 = DeconstructBox(Box=bbox_3.Box)  # -> Plane, X, Y, Z
X_7 = UnitX(Factor=addition_12)

# ----
# ADIÇÃO BILATERAL 90º
debox_6 = DeconstructBox(Box=bbox_3.Box)  # -> Plane, X, Y, Z
area_2 = Area(Geometry=bbox_3.Box)  # -> Area, Centroid
num_8 = Number(debox_6.X)
num_9 = Number(debox_6.Y)
division_13 = Division(A=num_8, B=2)
division_14 = Division(A=num_9, B=2)
addition_13 = Addition(A=division_14, B=division_13)
X_8 = UnitX(Factor=addition_13)
multiplication_42 = Multiplication(A=X_8, B=-1)
division_15 = Division(A=num_9, B=4)
Y_17 = UnitY(Factor=division_15)
multiplication_43 = Multiplication(A=Y_17, B=-1)

# ----
# ADIÇÃO LATERAL 90º
debox_7 = DeconstructBox(Box=bbox_3.Box)  # -> Plane, X, Y, Z
area_3 = Area(Geometry=bbox_3.Box)  # -> Area, Centroid
num_10 = Number(debox_7.X)
num_11 = Number(debox_7.Y)
division_16 = Division(A=num_10, B=2)
division_17 = Division(A=num_11, B=2)
addition_14 = Addition(A=division_17, B=division_16)
X_9 = UnitX(Factor=addition_14)
multiplication_44 = Multiplication(A=X_9, B=-1)

# ----
# ADIÇÃO CRUCIFORME 90º
debox_8 = DeconstructBox(Box=bbox_3.Box)  # -> Plane, X, Y, Z
area_4 = Area(Geometry=bbox_3.Box)  # -> Area, Centroid
num_12 = Number(debox_8.X)
num_13 = Number(debox_8.Y)
division_18 = Division(A=num_12, B=2)
division_19 = Division(A=num_13, B=2)
addition_15 = Addition(A=division_19, B=division_18)
X_10 = UnitX(Factor=addition_15)
multiplication_45 = Multiplication(A=X_10, B=-1)

# ----
# ADIÇÃO EM "U" 90º
area_5 = Area(Geometry=bbox_3.Box)  # -> Area, Centroid
debox_9 = DeconstructBox(Box=bbox_3.Box)  # -> Plane, X, Y, Z
num_14 = Number(debox_9.X)
num_15 = Number(debox_9.Y)
division_20 = Division(A=num_14, B=2)
division_21 = Division(A=num_15, B=2)
addition_16 = Addition(A=division_21, B=division_20)
X_11 = UnitX(Factor=addition_16)
multiplication_46 = Multiplication(A=X_11, B=-1)
num_16 = Number(debox_9.Y)

# ----
# ADIÇÃO EM "H" 90º
area_6 = Area(Geometry=bbox_3.Box)  # -> Area, Centroid
debox_10 = DeconstructBox(Box=bbox_3.Box)  # -> Plane, X, Y, Z
num_17 = Number(debox_10.X)
num_18 = Number(debox_10.Y)
division_22 = Division(A=num_17, B=2)
division_23 = Division(A=num_18, B=2)
addition_17 = Addition(A=division_23, B=division_22)
X_12 = UnitX(Factor=addition_17)
multiplication_47 = Multiplication(A=X_12, B=-1)

debox_11 = DeconstructBox(Box=bbox_4.Box)  # -> Plane, X, Y, Z
num_19 = Number(debox_11.Y)
comp_total_4 = Panel(num_19)
addition_18 = Addition(A=comp_total_4, B=multiplication_40)
Y_18 = UnitY(Factor=addition_18)
move_12 = Move(Geometry=dup_7, Motion=Y_18)  # -> flatten(Geometry), Transform

# ----
# PERFIS DE FECHAMENTO
# DAS EXTREMIDADES
perfil_de_fechamento_das_extremidades = Slider(0, range=0..1)
gate_8 = StreamGate(Stream=[extr_10, move_9.Geometry], Gate=perfil_de_fechamento_das_extremidades)  # -> Target0, simplify(Target1)
gate_9 = StreamGate(Stream=[extr_11, move_10.Geometry], Gate=perfil_de_fechamento_das_extremidades)  # -> Target0, simplify(Target1)
gate_10 = StreamGate(Stream=[extr_12, move_11.Geometry], Gate=perfil_de_fechamento_das_extremidades)  # -> Target0, simplify(Target1)
gate_11 = StreamGate(Stream=[move_12.Geometry, extr_13], Gate=perfil_de_fechamento_das_extremidades)  # -> Target0, simplify(Target1)

join_13 = BrepJoin(Breps=[arrlinear.Geometry, gate_8.Target1])  # -> Breps, Closed
join_14 = BrepJoin(Breps=[arrlinear_2.Geometry, gate_9.Target1])  # -> Breps, Closed
join_15 = BrepJoin(Breps=[brep, gate_10.Target1])  # -> Breps, Closed

brep_2 = Brep([brep, join_15.Breps])
rotate = Rotate(Geometry=join_14.Breps, Angle=1.570796327, Plane=area.Centroid)  # -> Geometry, Transform
rotate_2 = Rotate(Geometry=[arrlinear_4.Geometry, gate_11.Target1], Angle=1.570796327, Plane=area.Centroid)  # -> Geometry, Transform
move_13 = Move(Geometry=rotate.Geometry, Motion=multiplication_41)  # -> Geometry, Transform
move_14 = Move(Geometry=rotate_2.Geometry, Motion=multiplication_41)  # -> Geometry, Transform
bbox_5 = BoundingBox(Content=move_13.Geometry, Plane=PlaneXY(0, 0, 0), UnionBox=True)  # -> Box, Box_2
bbox_6 = BoundingBox(Content=move_13.Geometry, Plane=PlaneXY(0, 0, 0), UnionBox=True)  # -> Box, Box_2
debox_12 = DeconstructBox(Box=bbox_5.Box)  # -> Plane, X, Y, Z
debox_13 = DeconstructBox(Box=bbox_6.Box)  # -> Plane, X, Y, Z
num_20 = Number(debox_12.Y)
num_21 = Number(debox_13.Y)
multiplication_48 = Multiplication(A=num_20, B=-1)
multiplication_49 = Multiplication(A=num_21, B=-1)
addition_19 = Addition(A=num_6, B=multiplication_48)
addition_20 = Addition(A=num_7, B=multiplication_49)
division_24 = Division(A=addition_19, B=2)
Y_19 = UnitY(Factor=division_24)
move_15 = Move(Geometry=move_13.Geometry, Motion=Y_19)  # -> Geometry, Transform
division_25 = Division(A=addition_20, B=2)
multiplication_50 = Multiplication(A=division_25, B=-1)
Y_20 = UnitY(Factor=multiplication_50)
move_16 = Move(Geometry=move_14.Geometry, Motion=Y_20)  # -> Geometry, Transform

join_16 = BrepJoin(Breps=move_13.Geometry)  # -> flatten(Breps), Closed

brep_3 = Brep(join_15.Breps)
rotate_3 = Rotate(Geometry=join_13.Breps, Angle=1.570796327, Plane=area_2.Centroid)  # -> Geometry, Transform
rotate_4 = Rotate(Geometry=join_14.Breps, Angle=1.570796327, Plane=area_2.Centroid)  # -> Geometry, Transform
move_17 = Move(Geometry=rotate_4.Geometry, Motion=multiplication_42)  # -> flatten(Geometry), Transform
move_18 = Move(Geometry=rotate_3.Geometry, Motion=multiplication_42)  # -> flatten(Geometry), Transform
mirror = Mirror(Geometry=move_17.Geometry, Plane=PlaneYZ(0, 0, 0))  # -> Geometry, Transform
move_19 = Move(Geometry=mirror.Geometry, Motion=multiplication_43)  # -> Geometry, Transform
bbox_7 = BoundingBox(Content=move_19.Geometry, Plane=PlaneXY(0, 0, 0), UnionBox=True)  # -> Box, Box_2
dup_8 = DuplicateData(Data=mirror.Geometry, Number=2, Order=True)
area_7 = Area(Geometry=bbox_7.Box)  # -> Area, Centroid
move_20 = Move(Geometry=dup_8, Motion=Y_17)  # -> Geometry, Transform
rotate_5 = Rotate(Geometry=move_19.Geometry, Angle=3.141592654, Plane=area_7.Centroid)  # -> Geometry, Transform

brep_4 = Brep(join_15.Breps)
move_21 = Move(Geometry=join_14.Breps, Motion=X_7)  # -> Geometry, Transform
mirror_2 = Mirror(Geometry=move_21.Geometry, Plane=PlaneYZ(0, 0, 0))  # -> Geometry, Transform
join_17 = BrepJoin(Breps=mirror_2.Geometry)  # -> Breps, Closed

brep_5 = Brep(join_15.Breps)
rotate_6 = Rotate(Geometry=join_14.Breps, Angle=1.570796327, Plane=area_3.Centroid)  # -> Geometry, Transform
move_22 = Move(Geometry=rotate_6.Geometry, Motion=multiplication_44)  # -> Geometry, Transform

brep_6 = Brep(join_15.Breps)
rotate_7 = Rotate(Geometry=join_13.Breps, Angle=1.570796327, Plane=area_4.Centroid)  # -> Geometry, Transform
rotate_8 = Rotate(Geometry=join_14.Breps, Angle=1.570796327, Plane=area_4.Centroid)  # -> Geometry, Transform
move_23 = Move(Geometry=rotate_8.Geometry, Motion=multiplication_45)  # -> Geometry, Transform
move_24 = Move(Geometry=rotate_7.Geometry, Motion=multiplication_45)  # -> flatten(Geometry), Transform
mirror_3 = Mirror(Geometry=move_23.Geometry, Plane=PlaneYZ(0, 0, 0))  # -> flatten(Geometry), Transform

brep_7 = Brep(join_15.Breps)
rotate_9 = Rotate(Geometry=join_14.Breps, Angle=1.570796327, Plane=area_5.Centroid)  # -> Geometry, Transform
move_25 = Move(Geometry=rotate_9.Geometry, Motion=multiplication_46)  # -> Geometry, Transform
bbox_8 = BoundingBox(Content=move_25.Geometry, Plane=PlaneXY(0, 0, 0), UnionBox=True)  # -> Box, Box_2
debox_14 = DeconstructBox(Box=bbox_8.Box)  # -> Plane, X, Y, Z
num_22 = Number(debox_14.Y)
multiplication_51 = Multiplication(A=num_22, B=-1)
addition_21 = Addition(A=num_16, B=multiplication_51)
division_26 = Division(A=addition_21, B=2)
Y_21 = UnitY(Factor=division_26)
move_26 = Move(Geometry=move_25.Geometry, Motion=Y_21)  # -> Geometry, Transform

join_18 = BrepJoin(Breps=move_25.Geometry)  # -> flatten(Breps), Closed

bbox_9 = BoundingBox(Content=join_18.Breps, Plane=PlaneXY(0, 0, 0), UnionBox=True)  # -> Box, Box_2
area_8 = Area(Geometry=bbox_9.Box)  # -> Area, Centroid
rotate_10 = Rotate(Geometry=join_13.Breps, Angle=15.70796327, Plane=area_8.Centroid)  # -> Geometry, Transform
geo_2 = Geometry([rotate_10.Geometry, move_26.Geometry, brep_7])

brep_8 = Brep(join_15.Breps)
rotate_11 = Rotate(Geometry=join_14.Breps, Angle=1.570796327, Plane=area_6.Centroid)  # -> Geometry, Transform
move_27 = Move(Geometry=rotate_11.Geometry, Motion=multiplication_47)  # -> Geometry, Transform

join_19 = BrepJoin(Breps=move_27.Geometry)  # -> flatten(Breps), Closed

bbox_10 = BoundingBox(Content=join_19.Breps, Plane=PlaneXY(0, 0, 0), UnionBox=True)  # -> Box, Box_2
area_9 = Area(Geometry=bbox_10.Box_2)  # -> Area, Centroid
rotate_12 = Rotate(Geometry=join_13.Breps, Angle=15.70796327, Plane=area_9.Centroid)  # -> Geometry, Transform

bbox_11 = BoundingBox(Content=join_16.Breps, Plane=PlaneXY(0, 0, 0), UnionBox=True)  # -> Box, Box_2
area_10 = Area(Geometry=bbox_11.Box)  # -> Area, Centroid
rotate_13 = Rotate(Geometry=join_13.Breps, Angle=15.70796327, Plane=area_10.Centroid)  # -> Geometry, Transform

domain = Domain(debox_5.Y)
bbox_12 = BoundingBox(Content=join_17.Breps, Plane=PlaneXY(0, 0, 0), UnionBox=True)  # -> Box, Box_2
dedomain = DeconstructDomain(Domain=domain)  # -> Start, End
pt_38 = ConstructPoint(XCoordinate=0, YCoordinate=dedomain.End, ZCoordinate=0)
debox_15 = DeconstructBox(Box=bbox_12.Box)  # -> Plane, X, Y, Z
num_23 = Number(debox_15.Y)
addition_22 = Addition(A=num_23, B=dedomain.Start)
multiplication_52 = Multiplication(A=num_23, B=-1)
pt_39 = ConstructPoint(XCoordinate=0, YCoordinate=addition_22, ZCoordinate=0)
ln_28 = Line(StartPoint=pt_39, EndPoint=pt_38)

eval = EvaluateCurve(Curve=reparameterize(ln_28), Parameter=adição_lateral_comum_p03)  # -> Point, Tangent, Angle

num_24 = Number(eval.Point)
addition_23 = Addition(A=num_24, B=multiplication_52)
Y_22 = UnitY(Factor=addition_23)
move_28 = Move(Geometry=join_17.Breps, Motion=Y_22)  # -> Geometry, Transform

geo_3 = Geometry([move_28.Geometry, brep_4])

division_27 = Division(A=num_9, B=-2)
bbox_13 = BoundingBox(Content=move_18.Geometry, Plane=PlaneXY(0, 0, 0), UnionBox=True)  # -> Box, Box_2
domain_2 = Domain(debox_6.Y)
debox_16 = DeconstructBox(Box=bbox_13.Box)  # -> Plane, X, Y, Z
num_25 = Number(debox_16.Y)
multiplication_53 = Multiplication(A=num_25, B=-1)
division_28 = Division(A=num_25, B=2)
addition_24 = Addition(A=division_27, B=division_28)
Y_23 = UnitY(Factor=addition_24)
move_29 = Move(Geometry=move_18.Geometry, Motion=Y_23)  # -> Geometry, Transform
dedomain_2 = DeconstructDomain(Domain=domain_2)  # -> Start, End
pt_40 = ConstructPoint(XCoordinate=0, YCoordinate=dedomain_2.End, ZCoordinate=0)
addition_25 = Addition(A=num_25, B=dedomain_2.Start)
pt_41 = ConstructPoint(XCoordinate=0, YCoordinate=addition_25, ZCoordinate=0)
ln_29 = Line(StartPoint=pt_41, EndPoint=pt_40)

eval_2 = EvaluateCurve(Curve=reparameterize(ln_29), Parameter=mov_adição_bilateral_90º_p02)  # -> Point, Tangent, Angle

num_26 = Number(eval_2.Point)
addition_26 = Addition(A=num_26, B=multiplication_53)
Y_24 = UnitY(Factor=addition_26)
move_30 = Move(Geometry=move_29.Geometry, Motion=Y_24)  # -> Geometry, Transform

geo_4 = Geometry([rotate_5.Geometry, move_20.Geometry, move_30.Geometry, brep_3])

division_29 = Division(A=num_11, B=-2)
domain_3 = Domain(debox_7.Y)
bbox_14 = BoundingBox(Content=move_22.Geometry, Plane=PlaneXY(0, 0, 0), UnionBox=True)  # -> Box, Box_2
debox_17 = DeconstructBox(Box=bbox_14.Box)  # -> Plane, X, Y, Z
num_27 = Number(debox_17.Y)
multiplication_54 = Multiplication(A=num_27, B=-1)
division_30 = Division(A=num_27, B=2)
addition_27 = Addition(A=division_29, B=division_30)
Y_25 = UnitY(Factor=addition_27)
move_31 = Move(Geometry=move_22.Geometry, Motion=Y_25)  # -> Geometry, Transform
dedomain_3 = DeconstructDomain(Domain=domain_3)  # -> Start, End
pt_42 = ConstructPoint(XCoordinate=0, YCoordinate=dedomain_3.End, ZCoordinate=0)
addition_28 = Addition(A=num_27, B=dedomain_3.Start)
pt_43 = ConstructPoint(XCoordinate=0, YCoordinate=addition_28, ZCoordinate=0)
ln_30 = Line(StartPoint=pt_43, EndPoint=pt_42)

eval_3 = EvaluateCurve(Curve=reparameterize(ln_30), Parameter=mov_adição_lateral_90º_p02)  # -> Point, Tangent, Angle

num_28 = Number(eval_3.Point)
addition_29 = Addition(A=num_28, B=multiplication_54)
Y_26 = UnitY(Factor=addition_29)
move_32 = Move(Geometry=move_31.Geometry, Motion=Y_26)  # -> Geometry, Transform

geo_5 = Geometry([move_32.Geometry, brep_5])

division_31 = Division(A=num_18, B=-2)
domain_4 = Domain(debox_10.Y)
bbox_15 = BoundingBox(Content=move_27.Geometry, Plane=PlaneXY(0, 0, 0), UnionBox=True)  # -> Box, Box_2
debox_18 = DeconstructBox(Box=bbox_15.Box)  # -> Plane, X, Y, Z
num_29 = Number(debox_18.Y)
multiplication_55 = Multiplication(A=num_29, B=-1)
division_32 = Division(A=num_29, B=2)
addition_30 = Addition(A=division_31, B=division_32)
Y_27 = UnitY(Factor=addition_30)
move_33 = Move(Geometry=move_27.Geometry, Motion=Y_27)  # -> Geometry, Transform
dedomain_4 = DeconstructDomain(Domain=domain_4)  # -> Start, End
pt_44 = ConstructPoint(XCoordinate=0, YCoordinate=dedomain_4.End, ZCoordinate=0)
addition_31 = Addition(A=num_29, B=dedomain_4.Start)
pt_45 = ConstructPoint(XCoordinate=0, YCoordinate=addition_31, ZCoordinate=0)
ln_31 = Line(StartPoint=pt_45, EndPoint=pt_44)

eval_4 = EvaluateCurve(Curve=reparameterize(ln_31), Parameter=mov_adição_em_h_90º_p02)  # -> Point, Tangent, Angle

num_30 = Number(eval_4.Point)
addition_32 = Addition(A=num_30, B=multiplication_55)
Y_28 = UnitY(Factor=addition_32)
move_34 = Move(Geometry=move_33.Geometry, Motion=Y_28)  # -> Geometry, Transform

geo_6 = Geometry([rotate_12.Geometry, move_34.Geometry, brep_8])

division_33 = Division(A=num_13, B=-2)
division_34 = Division(A=num_13, B=-2)
domain_5 = Domain(debox_8.Y)
domain_6 = Domain(debox_8.Y)
bbox_16 = BoundingBox(Content=mirror_3.Geometry, Plane=PlaneXY(0, 0, 0), UnionBox=True)  # -> Box, Box_2
bbox_17 = BoundingBox(Content=move_24.Geometry, Plane=PlaneXY(0, 0, 0), UnionBox=True)  # -> Box, Box_2
debox_19 = DeconstructBox(Box=bbox_16.Box)  # -> Plane, X, Y, Z
debox_20 = DeconstructBox(Box=bbox_17.Box)  # -> Plane, X, Y, Z
num_31 = Number(debox_19.Y)
num_32 = Number(debox_20.Y)
multiplication_56 = Multiplication(A=num_31, B=-1)
multiplication_57 = Multiplication(A=num_32, B=-1)
division_35 = Division(A=num_31, B=2)
addition_33 = Addition(A=division_33, B=division_35)
Y_29 = UnitY(Factor=addition_33)
move_35 = Move(Geometry=mirror_3.Geometry, Motion=Y_29)  # -> Geometry, Transform
division_36 = Division(A=num_32, B=2)
addition_34 = Addition(A=division_34, B=division_36)
Y_30 = UnitY(Factor=addition_34)
move_36 = Move(Geometry=move_24.Geometry, Motion=Y_30)  # -> Geometry, Transform
dedomain_5 = DeconstructDomain(Domain=domain_6)  # -> Start, End
dedomain_6 = DeconstructDomain(Domain=domain_5)  # -> Start, End
pt_46 = ConstructPoint(XCoordinate=0, YCoordinate=dedomain_5.End, ZCoordinate=0)
pt_47 = ConstructPoint(XCoordinate=0, YCoordinate=dedomain_6.End, ZCoordinate=0)
addition_35 = Addition(A=num_31, B=dedomain_5.Start)
addition_36 = Addition(A=num_32, B=dedomain_6.Start)
pt_48 = ConstructPoint(XCoordinate=0, YCoordinate=addition_35, ZCoordinate=0)
pt_49 = ConstructPoint(XCoordinate=0, YCoordinate=addition_36, ZCoordinate=0)
ln_32 = Line(StartPoint=pt_48, EndPoint=pt_46)
ln_33 = Line(StartPoint=pt_49, EndPoint=pt_47)

eval_5 = EvaluateCurve(Curve=reparameterize(ln_32), Parameter=mov_adição_cruciforme_90º_p02)  # -> Point, Tangent, Angle
eval_6 = EvaluateCurve(Curve=reparameterize(ln_33), Parameter=mov_adição_cruciforme_90º_p03)  # -> Point, Tangent, Angle

num_33 = Number(eval_5.Point)
addition_37 = Addition(A=num_33, B=multiplication_56)
Y_31 = UnitY(Factor=addition_37)
num_34 = Number(eval_6.Point)
addition_38 = Addition(A=num_34, B=multiplication_57)
Y_32 = UnitY(Factor=addition_38)
move_37 = Move(Geometry=move_35.Geometry, Motion=Y_31)  # -> Geometry, Transform
move_38 = Move(Geometry=move_36.Geometry, Motion=Y_32)  # -> Geometry, Transform

geo_7 = Geometry([move_37.Geometry, move_38.Geometry, brep_6])

division_37 = Division(A=num_5, B=-2)
division_38 = Division(A=num_5, B=-2)
domain_7 = Domain(debox_4.Y)
domain_8 = Domain(debox_4.Y)
bbox_18 = BoundingBox(Content=move_13.Geometry, Plane=PlaneXY(0, 0, 0), UnionBox=True)  # -> Box, Box_2
bbox_19 = BoundingBox(Content=move_14.Geometry, Plane=PlaneXY(0, 0, 0), UnionBox=True)  # -> Box, Box_2
debox_21 = DeconstructBox(Box=bbox_18.Box)  # -> Plane, X, Y, Z
debox_22 = DeconstructBox(Box=bbox_19.Box)  # -> Plane, X, Y, Z
num_35 = Number(debox_21.Y)
num_36 = Number(debox_22.Y)
multiplication_58 = Multiplication(A=num_35, B=-1)
multiplication_59 = Multiplication(A=num_36, B=-1)
division_39 = Division(A=num_35, B=2)
addition_39 = Addition(A=division_37, B=division_39)
Y_33 = UnitY(Factor=addition_39)
move_39 = Move(Geometry=move_13.Geometry, Motion=Y_33)  # -> Geometry, Transform
division_40 = Division(A=num_36, B=2)
addition_40 = Addition(A=division_38, B=division_40)
Y_34 = UnitY(Factor=addition_40)
move_40 = Move(Geometry=move_14.Geometry, Motion=Y_34)  # -> Geometry, Transform
dedomain_7 = DeconstructDomain(Domain=domain_7)  # -> Start, End
dedomain_8 = DeconstructDomain(Domain=domain_8)  # -> Start, End
pt_50 = ConstructPoint(XCoordinate=0, YCoordinate=dedomain_7.End, ZCoordinate=0)
pt_51 = ConstructPoint(XCoordinate=0, YCoordinate=dedomain_8.End, ZCoordinate=0)
addition_41 = Addition(A=num_35, B=dedomain_7.Start)
addition_42 = Addition(A=num_36, B=dedomain_8.Start)
pt_52 = ConstructPoint(XCoordinate=0, YCoordinate=addition_41, ZCoordinate=0)
pt_53 = ConstructPoint(XCoordinate=0, YCoordinate=addition_42, ZCoordinate=0)
ln_34 = Line(StartPoint=pt_52, EndPoint=pt_50)
ln_35 = Line(StartPoint=pt_53, EndPoint=pt_51)

eval_7 = EvaluateCurve(Curve=reparameterize(ln_35), Parameter=mov_adição_em_o_90º_p03)  # -> Point, Tangent, Angle
eval_8 = EvaluateCurve(Curve=reparameterize(ln_34), Parameter=mov_adição_em_o_90º_p02)  # -> Point, Tangent, Angle

num_37 = Number(eval_8.Point)
addition_43 = Addition(A=num_37, B=multiplication_58)
Y_35 = UnitY(Factor=addition_43)
num_38 = Number(eval_7.Point)
addition_44 = Addition(A=num_38, B=multiplication_59)
Y_36 = UnitY(Factor=addition_44)
move_41 = Move(Geometry=move_39.Geometry, Motion=Y_35)  # -> Geometry, Transform
move_42 = Move(Geometry=move_40.Geometry, Motion=Y_36)  # -> Geometry, Transform

geo_8 = Geometry([rotate_13.Geometry, move_41.Geometry, move_42.Geometry, brep_2])

# ----
# DISTRIBUIÇÃO
panel_12 = Panel("""1
0
0
0
0
0
0
0""")
list = ValueList({"Pavilionar": 0, "Adição Lateral": -1, "Adição Cruciforme em 90º": -2, "Adição Bilateral em 90º": -3, "Adição Lateral Comum": -4, "Adição em \"H\" em 90º": -5, "Adição em \"U\" em 90º": -6, "Adição em \"O\" em 90º": -7}, selected="Adição Lateral Comum")
shift = ShiftList(List=panel_12, Shift=list, Wrap=True)
item_4 = ListItem(List=shift, Index=0, Wrap=False)  # -> Item, Item1, Item2, Item3, Item4, Item5, Item6, Item7
gate_12 = StreamGate(Stream=join_15.Breps, Gate=item_4.Item)  # -> Target0, simplify(Target1)
gate_13 = StreamGate(Stream=geo_5, Gate=item_4.Item1)  # -> Target0, simplify(Target1)
gate_14 = StreamGate(Stream=geo_7, Gate=item_4.Item2)  # -> Target0, simplify(Target1)
gate_15 = StreamGate(Stream=geo_4, Gate=item_4.Item3)  # -> Target0, simplify(Target1)
gate_16 = StreamGate(Stream=geo_3, Gate=item_4.Item4)  # -> Target0, simplify(Target1)
gate_17 = StreamGate(Stream=geo_6, Gate=item_4.Item5)  # -> Target0, simplify(Target1)
gate_18 = StreamGate(Stream=geo_2, Gate=item_4.Item6)  # -> Target0, simplify(Target1)
gate_19 = StreamGate(Stream=geo_8, Gate=item_4.Item7)  # -> Target0, simplify(Target1)

geo_9 = Geometry(simplify([gate_13.Target1, gate_14.Target1, gate_12.Target1, gate_15.Target1, gate_16.Target1, gate_17.Target1, gate_18.Target1, gate_19.Target1]))

addition_45 = Addition(A=vão_transversal_p03, B=-300)
addition_46 = Addition(A=vão_transversal_p01, B=-300)
addition_47 = Addition(A=vão_transversal_p01, B=-300)
addition_48 = Addition(A=vão_transversal_p02, B=-300)
addition_49 = Addition(A=item_4.Item1, B=item_4.Item2, C=item_4.Item3, D=item_4.Item4, E=item_4.Item5, F=item_4.Item6, G=item_4.Item7)
addition_50 = Addition(A=item_4.Item2, B=item_4.Item3, C=item_4.Item5, D=item_4.Item6, E=item_4.Item7)
multiplication_60 = Multiplication(A=comp_total, B=addition_47)
multiplication_61 = Multiplication(A=comp_total_3, B=addition_48)
multiplication_62 = Multiplication(A=comp_total_2, B=addition_45)
multiplication_63 = Multiplication(A=comp_total_4, B=addition_46)
multiplication_64 = Multiplication(A=multiplication_61, B=2)
gate_20 = StreamGate(Stream=multiplication_61, Gate=item_4.Item1)  # -> Target0, simplify(Target1)
gate_21 = StreamGate(Stream=multiplication_61, Gate=item_4.Item2)  # -> Target0, simplify(Target1)
gate_22 = StreamGate(Stream=multiplication_64, Gate=item_4.Item3)  # -> Target0, simplify(Target1)
gate_23 = StreamGate(Stream=multiplication_61, Gate=item_4.Item4)  # -> Target0, simplify(Target1)
gate_24 = StreamGate(Stream=multiplication_61, Gate=item_4.Item5)  # -> Target0, simplify(Target1)
gate_25 = StreamGate(Stream=multiplication_61, Gate=item_4.Item6)  # -> Target0, simplify(Target1)
gate_26 = StreamGate(Stream=multiplication_61, Gate=item_4.Item7)  # -> Target0, simplify(Target1)
gate_27 = StreamGate(Stream=multiplication_62, Gate=item_4.Item2)  # -> Target0, simplify(Target1)
gate_28 = StreamGate(Stream=multiplication_62, Gate=item_4.Item3)  # -> Target0, simplify(Target1)
gate_29 = StreamGate(Stream=multiplication_62, Gate=item_4.Item5)  # -> Target0, simplify(Target1)
gate_30 = StreamGate(Stream=multiplication_62, Gate=item_4.Item6)  # -> Target0, simplify(Target1)
gate_31 = StreamGate(Stream=multiplication_62, Gate=item_4.Item7)  # -> Target0, simplify(Target1)
gate_32 = StreamGate(Stream=multiplication_63, Gate=item_4.Item7)  # -> Target0, simplify(Target1)
division_41 = Division(A=multiplication_60, B=1000000)
division_42 = Division(
    A=[gate_20.Target1, gate_21.Target1, gate_22.Target1, gate_23.Target1, gate_24.Target1, gate_25.Target1, gate_26.Target1],
    B=1000000)
division_43 = Division(A=[gate_27.Target1, gate_28.Target1, gate_29.Target1, gate_30.Target1, gate_31.Target1], B=1000000)
division_44 = Division(A=gate_32.Target1, B=1000000)
addition_51 = Addition(A=division_41, B=division_42, C=division_43, D=division_44)
round = Round(Number=division_42)  # -> Nearest, Floor, Ceiling
round_2 = Round(Number=division_41)  # -> Nearest, Floor, Ceiling
round_3 = Round(Number=division_43)  # -> Nearest, Floor, Ceiling
round_4 = Round(Number=division_44)  # -> Nearest, Floor, Ceiling
Y_37 = UnitY(Factor=-1500)
Y_38 = UnitY(Factor=-4000)
X_13 = UnitX(Factor=5500)
pt_54 = Point(Point(-9510, -2754, 0))
área_total = Panel("""TFG II - UFN
ARQUITETURA
E URBANISMO
05/12/2019""")
área_total_2 = Panel("""ORIENTANDO:
LEONARDO FANFA PEDROSO
ORIENTADORA: 
CLARISSA DE OLIVEIRA PEREIRA""")
área_total_3 = Panel(round_2.Nearest)
área_total_4 = Panel("""ÁREA  (m²):
COMP. (m):
LARG. (m):
PREÇO (R$):""")
move_43 = Move(Geometry=pt_54, Motion=Y_38)  # -> Geometry, Transform
move_44 = Move(Geometry=pt_54, Motion=X_13)  # -> Geometry, Transform
move_45 = Move(Geometry=move_43.Geometry, Motion=X_13)  # -> Geometry, Transform
C = Colour(RGB(48, 48, 48))
tag = TextTag3D(Location=move_44.Geometry, Text=área_total_3, Size=500, Colour=C, Justification=1)
tag_2 = TextTag3D(Location=pt_54, Text=área_total_4, Size=500, Colour=C, Justification=1)
tag_3 = TextTag3D(Location=move_43.Geometry, Text=área_total, Size=500, Colour=C, Justification=1)
tag_4 = TextTag3D(Location=move_45.Geometry, Text=área_total_2, Size=500, Colour=C, Justification=1)

formato_do_arquivo = Panel("3dm")
nome_do_arquivo = Panel("WikiHouse_TFGII_UFN_R01")
download_do_modelo = ShapeDiverExportDownload(Geometry=[geo_9, geo], Format=formato_do_arquivo, Name=nome_do_arquivo)

materialidade = ValueList({"Padrão": 100, "Plástico": 200, "Metal": 300, "Madeira": 550}, selected="Madeira")
panel_13 = Panel(materialidade)
sdsimplematerial = ShapeDiverSimpleMaterial(Color=RGB(255, 255, 255), MaterialIndex=panel_13)
displaybox = ShapeDiverDisplayGeometry(Geometry=[geo_9, geo], ShapeDiverMaterial=sdsimplematerial)

gate_33 = StreamGate(Stream=vão_transversal_p03, Gate=addition_50)  # -> Target0, Target1
gate_34 = StreamGate(Stream=comp_total_2, Gate=addition_50)  # -> Target0, Target1
X_14 = UnitX(Factor=12000)
Y_39 = UnitY(Factor=-850)
Y_40 = UnitY(Factor=-1650)
pt_55 = Point(pt_54)
move_46 = Move(Geometry=pt_55, Motion=X_14)  # -> Geometry, Transform
move_47 = Move(Geometry=pt_55, Motion=X_14)  # -> Geometry, Transform
comprimento_total_2 = Panel(gate_34.Target1)
largura_total = Panel(gate_33.Target1)
move_48 = Move(Geometry=move_47.Geometry, Motion=Y_39)  # -> Geometry, Transform
move_49 = Move(Geometry=move_46.Geometry, Motion=Y_40)  # -> Geometry, Transform
division_45 = Division(A=largura_total, B=1000)
division_46 = Division(A=comprimento_total_2, B=1000)
tag_5 = TextTag3D(Location=move_48.Geometry, Text=division_46, Size=500, Colour=C, Justification=1)
tag_6 = TextTag3D(Location=move_49.Geometry, Text=division_45, Size=500, Colour=C, Justification=1)
área_total_5 = Panel(round_3.Nearest)
Y_41 = UnitY(Factor=750)
comprimento_total_3 = Panel("P03")
gate_35 = StreamGate(Stream=comprimento_total_3, Gate=addition_50)  # -> Target0, Target1
gate_36 = StreamGate(Stream=área_total_5, Gate=addition_49)  # -> Target0, Target1

gate_37 = StreamGate(Stream=vão_transversal_p02, Gate=addition_49)  # -> Target0, Target1
gate_38 = StreamGate(Stream=comp_total_3, Gate=addition_49)  # -> Target0, Target1
X_15 = UnitX(Factor=9000)
Y_42 = UnitY(Factor=-850)
Y_43 = UnitY(Factor=-1650)
pt_56 = Point(pt_54)
move_50 = Move(Geometry=pt_56, Motion=X_15)  # -> Geometry, Transform
move_51 = Move(Geometry=pt_56, Motion=X_15)  # -> Geometry, Transform
comprimento_total_4 = Panel(gate_38.Target1)
largura_total_2 = Panel(gate_37.Target1)
move_52 = Move(Geometry=move_51.Geometry, Motion=Y_42)  # -> Geometry, Transform
move_53 = Move(Geometry=move_50.Geometry, Motion=Y_43)  # -> Geometry, Transform
division_47 = Division(A=largura_total_2, B=1000)
division_48 = Division(A=comprimento_total_4, B=1000)
tag_7 = TextTag3D(Location=move_52.Geometry, Text=division_48, Size=500, Colour=C, Justification=1)
tag_8 = TextTag3D(Location=move_53.Geometry, Text=division_47, Size=500, Colour=C, Justification=1)
área_total_6 = Panel(round.Nearest)
Y_44 = UnitY(Factor=750)
comprimento_total_5 = Panel("P02")
gate_39 = StreamGate(Stream=comprimento_total_5, Gate=addition_49)  # -> Target0, Target1
gate_40 = StreamGate(Stream=área_total_6, Gate=addition_49)  # -> Target0, Target1

Y_45 = UnitY(Factor=-850)
X_16 = UnitX(Factor=5500)
Y_46 = UnitY(Factor=-1650)
X_17 = UnitX(Factor=5500)
pt_57 = Point(pt_54)
pt_58 = Point(pt_54)
largura_total_3 = Panel(vão_transversal_p01)
comprimento_total_6 = Panel(comp_total)
move_54 = Move(Geometry=pt_58, Motion=X_17)  # -> Geometry, Transform
move_55 = Move(Geometry=move_54.Geometry, Motion=Y_46)  # -> Geometry, Transform
move_56 = Move(Geometry=pt_57, Motion=X_16)  # -> Geometry, Transform
move_57 = Move(Geometry=move_56.Geometry, Motion=Y_45)  # -> Geometry, Transform
division_49 = Division(A=largura_total_3, B=1000)
division_50 = Division(A=comprimento_total_6, B=1000)
tag_9 = TextTag3D(Location=move_57.Geometry, Text=division_50, Size=500, Colour=C, Justification=1)
tag_10 = TextTag3D(Location=move_55.Geometry, Text=division_49, Size=500, Colour=C, Justification=1)
Y_47 = UnitY(Factor=750)
comprimento_total_7 = Panel("P01")
move_58 = Move(Geometry=pt_58, Motion=Y_47)  # -> Geometry, Transform

move_59 = Move(Geometry=pt_58, Motion=Y)  # -> Geometry, Transform

multiplication_65 = Multiplication(A=área_total_3, B=preço_por_metro_quadrado)
Y_48 = UnitY(Factor=-2450)
X_18 = UnitX(Factor=5500)
move_60 = Move(Geometry=pt_58, Motion=X_18)  # -> Geometry, Transform
move_61 = Move(Geometry=move_60.Geometry, Motion=Y_48)  # -> Geometry, Transform
tag_11 = TextTag3D(Location=move_61.Geometry, Text=multiplication_65, Size=500, Colour=C, Justification=1)

multiplication_66 = Multiplication(A=área_total_5, B=preço_por_metro_quadrado)
X_19 = UnitX(Factor=X_14)
move_62 = Move(Geometry=pt_58, Motion=X_19)  # -> Geometry, Transform
move_63 = Move(Geometry=move_62.Geometry, Motion=Y_48)  # -> Geometry, Transform
tag_12 = TextTag3D(Location=move_63.Geometry, Text=multiplication_66, Size=500, Colour=C, Justification=1)

multiplication_67 = Multiplication(A=área_total_6, B=preço_por_metro_quadrado)
X_20 = UnitX(Factor=X_15)
move_64 = Move(Geometry=pt_58, Motion=X_20)  # -> Geometry, Transform
move_65 = Move(Geometry=move_64.Geometry, Motion=Y_48)  # -> Geometry, Transform
tag_13 = TextTag3D(Location=move_65.Geometry, Text=multiplication_67, Size=500, Colour=C, Justification=1)

move_66 = Move(Geometry=move_58.Geometry, Motion=X)  # -> Geometry, Transform

tag_14 = TextTag3D(Location=move_66.Geometry, Text=comprimento_total_7, Size=500, Colour=C, Justification=1)

tag_15 = TextTag3D(Location=move_59.Geometry, Text=comprimento_total, Size=500, Colour=C, Justification=1)

gate_41 = StreamGate(Stream=vão_transversal_p01, Gate=item_4.Item7)  # -> Target0, simplify(Target1)
gate_42 = StreamGate(Stream=comp_total_4, Gate=item_4.Item7)  # -> Target0, simplify(Target1)
X_21 = UnitX(Factor=15500)
Y_49 = UnitY(Factor=-850)
Y_50 = UnitY(Factor=-1650)
pt_59 = Point(pt_54)
move_67 = Move(Geometry=pt_59, Motion=X_21)  # -> Geometry, Transform
move_68 = Move(Geometry=pt_59, Motion=X_21)  # -> Geometry, Transform
comprimento_total_8 = Panel(gate_42.Target1)
largura_total_4 = Panel(gate_41.Target1)
move_69 = Move(Geometry=move_68.Geometry, Motion=Y_49)  # -> Geometry, Transform
move_70 = Move(Geometry=move_67.Geometry, Motion=Y_50)  # -> Geometry, Transform
division_51 = Division(A=largura_total_4, B=1000)
division_52 = Division(A=comprimento_total_8, B=1000)
tag_16 = TextTag3D(Location=move_69.Geometry, Text=division_52, Size=500, Colour=C, Justification=1)
tag_17 = TextTag3D(Location=move_70.Geometry, Text=division_51, Size=500, Colour=C, Justification=1)
área_total_7 = Panel(round_4.Nearest)
Y_51 = UnitY(Factor=750)
comprimento_total_9 = Panel("P04")
gate_43 = StreamGate(Stream=comprimento_total_9, Gate=item_4.Item7)  # -> Target0, simplify(Target1)
move_71 = Move(Geometry=pt_58, Motion=Y_51)  # -> Geometry, Transform
move_72 = Move(Geometry=pt_58, Motion=X_21)  # -> Geometry, Transform
gate_44 = StreamGate(Stream=área_total_7, Gate=addition_49)  # -> Target0, Target1
tag_18 = TextTag3D(Location=move_72.Geometry, Text=gate_44.Target1, Size=500, Colour=C, Justification=1)

multiplication_68 = Multiplication(A=área_total_7, B=preço_por_metro_quadrado)
X_22 = UnitX(Factor=X_21)
move_73 = Move(Geometry=pt_58, Motion=X_22)  # -> Geometry, Transform
move_74 = Move(Geometry=move_73.Geometry, Motion=Y_48)  # -> Geometry, Transform
tag_19 = TextTag3D(Location=move_74.Geometry, Text=multiplication_68, Size=500, Colour=C, Justification=1)

move_75 = Move(Geometry=move_71.Geometry, Motion=X_4)  # -> Geometry, Transform

tag_20 = TextTag3D(Location=move_75.Geometry, Text=gate_43.Target1, Size=500, Colour=C, Justification=1)

move_76 = Move(Geometry=pt_58, Motion=X_15)  # -> Geometry, Transform
move_77 = Move(Geometry=pt_58, Motion=Y_44)  # -> Geometry, Transform
tag_21 = TextTag3D(Location=move_76.Geometry, Text=gate_40.Target1, Size=500, Colour=C, Justification=1)

move_78 = Move(Geometry=move_77.Geometry, Motion=X_2)  # -> Geometry, Transform

tag_22 = TextTag3D(Location=move_78.Geometry, Text=gate_39.Target1, Size=500, Colour=C, Justification=1)

move_79 = Move(Geometry=pt_58, Motion=Y_41)  # -> Geometry, Transform
move_80 = Move(Geometry=pt_58, Motion=X_14)  # -> Geometry, Transform
tag_23 = TextTag3D(Location=move_80.Geometry, Text=gate_36.Target1, Size=500, Colour=C, Justification=1)

move_81 = Move(Geometry=move_79.Geometry, Motion=X_3)  # -> Geometry, Transform

tag_24 = TextTag3D(Location=move_81.Geometry, Text=gate_35.Target1, Size=500, Colour=C, Justification=1)
